test file "InportedTests"

suite "Park Engagement Guard"

  case "PosBelow" [baseline]
    model TransmissionController, harness ParkEngagementGuard_Harness (for TransmissionController/Park Engagement Guard), mode Normal, start time 0, stop time 1
    input "PARK_in_r2_test1.mat", mapped to RequestedRange, VehicleSpeed (active)
    assessment "Assessment1": At any point of time, AcceptedRange == ParkValue must be true
      AcceptedRange: signal ParkEngagementGuard_Harness/Park Engagement Guard, port 1
      ParkValue: expression RangeSelected.Park

  case "PosAt" [baseline]
    model TransmissionController, harness ParkEngagementGuard_Harness (for TransmissionController/Park Engagement Guard), mode Normal, start time 0, stop time 1
    input "PARK_in_r2_test2.mat", mapped to RequestedRange, VehicleSpeed (active)
    assessment "Assessment1": At any point of time, AcceptedRange ~= ParkValue must be true
      AcceptedRange: signal ParkEngagementGuard_Harness/Park Engagement Guard, port 1
      ParkValue: expression RangeSelected.Park

  case "NegBelow" [baseline]
    model TransmissionController, harness ParkEngagementGuard_Harness (for TransmissionController/Park Engagement Guard), mode Normal, start time 0, stop time 1
    input "PARK_in_r2_test3.mat", mapped to RequestedRange, VehicleSpeed (active)
    assessment "Assessment1": At any point of time, AcceptedRange == ParkValue must be true
      AcceptedRange: signal ParkEngagementGuard_Harness/Park Engagement Guard, port 1
      ParkValue: expression RangeSelected.Park

  case "NegAt" [baseline]
    model TransmissionController, harness ParkEngagementGuard_Harness (for TransmissionController/Park Engagement Guard), mode Normal, start time 0, stop time 1
    input "PARK_in_r2_test4.mat", mapped to RequestedRange, VehicleSpeed (active)
    assessment "Assessment1": At any point of time, AcceptedRange ~= ParkValue must be true
      AcceptedRange: signal ParkEngagementGuard_Harness/Park Engagement Guard, port 1
      ParkValue: expression RangeSelected.Park

  suite "RP-03"

    case "Pos" [baseline]
      model TransmissionController, harness ParkEngagementGuard_Harness (for TransmissionController/Park Engagement Guard), mode Normal, start time 0, stop time 1
      input "RP_in_r03_test1.mat", mapped to RequestedRange, VehicleSpeed (active)
      assessment "Assessment1": At any point of time, AcceptedRange == ExpectedNeutral must be true
        AcceptedRange: signal ParkEngagementGuard_Harness/Park Engagement Guard, port 1
        ExpectedNeutral: expression RangeSelected.Neutral

    case "Neg" [baseline]
      model TransmissionController, harness ParkEngagementGuard_Harness (for TransmissionController/Park Engagement Guard), mode Normal, start time 0, stop time 1
      input "RP_in_r03_test2.mat", mapped to RequestedRange, VehicleSpeed (active)
      assessment "Assessment1": At any point of time, AcceptedRange == ExpectedNeutral must be true
        AcceptedRange: signal ParkEngagementGuard_Harness/Park Engagement Guard, port 1
        ExpectedNeutral: expression RangeSelected.Neutral