# Requirement set Transmission_Requirements (R2026a)

## 1 [#3] Engine Operating Limits
The transmission controller shall prevent operation of the engine outside its allowable operating range.

### 1.1 [#4] Maximum Engine Speed
The transmission controller shall prevent engine speed from exceeding 7250 RPM.
Rationale: Higher engine speeds will cause the internal piston forces to excess material limitations.

### 1.2 [#12] Minimum Engine Speed
The transmission contoller shall prevent the engine speed from falling below 700 RPM during engine oerations.
Rationale: Engine speeds below 800 RPM are outside the specified operating range and may cause the engine to stall or operate unstably.

## 2 [#1] Gear Selection Safety
The transmission controller shall permit gear selection only when operating conditions are valid for the requested gear.

### 2.1 [#2] Park Engagement
The transmission controller shall permit engagement of PARK only when |vehSpd| < 0.1 m/s
Rationale: Engaging the parking brake while the vehicle is moving can cause abrupt deceleration and place excessive stress on the parking mechanism.

### 2.2 [#14] Park Engagement Response
Following a valid PARK request, Parking Brake Command shall become true within 100 ms.
Rationale: Once the vehicle is nearly stationary, a long delay in parking brake engagement could allow it to roll before it is secured.

### 2.3 [#15] Park Release Response
Following a request to leave PARK, Parking Brake Command shall become false within 100 ms.
Rationale: A parking brake that remains engaged after the driver requests another range can oppose vehicle movement and load the drivetrain.

### 2.4 [#18] Drive Selection Safety
The controller shall treat a DRIVE request as valid only when Vehicle Speed > −0.5 m/s.
Rationale: Engaging a forward gear while the vehicle is moving backward can abruptly oppose the existing motion and load the drivetrain.

### 2.5 [#16] Reverse Selection Safety
The controller shall treat a REVERSE request as valid only when Vehicle Speed < 0.5 m/s.
Rationale: Engaging reverse while the vehicle is moving forward can abruptly oppose the existing motion and load the drivetrain.

### 2.6 [#17] Neutral Gear Availability
The transmission controller shall permit NEUTRAL regardless of vehicle speed.
Rationale: The driver may need to remove driving torque while the vehicle is still moving, including during an abnormal operating condition. Making NEUTRAL available at any speed preserves that option.

## 3 [#9] Driver Request Handling
The transmission controller shall process driver gear requests according to transmission operating constraints.

### 3.1 [#10] Park Request Protection
The transmission controller shall always command neutral when park is selected (GearComand = 0)
Rationale: If the transmission is in any drive or reverse gears it will cause undue strain on the engine and torque converter.

### 3.2 [#22] Drive Request Handling
The controller shall respond to a DRIVE request based on whether the Drive selection condition is satisfied.

#### 3.2.1 [#27] Valid Drive Request Response
When DRIVE is requested, Vehicle Speed > −0.5 m/s, and direction reversal protection is inactive, the controller shall command an integer GearCommand from 1 through 10.
Rationale: An accepted DRIVE request must produce a usable forward gear so the vehicle can respond to the accelerator.

#### 3.2.2 [#28] Invalid Drive Request Response
When DRIVE is requested and VehicleSpeed <= -0.5 m/s, the controller shall command GearCommand = 0.
Rationale: Applying forward driving torque while the vehicle is moving backward too quickly could produce an abrupt change in drivetrain loading.

### 3.3 [#23] Reverse Request Handling
The controller shall respond to a REVERSE request based on whether the Reverse selection condition is satisfied.

#### 3.3.1 [#38] Valid Reverse Request Response
When REVERSE is requested and satisfied ( Vehicle Speed < 0.5 m/s, and direction reversal protection is inactive ) the controller shall command GearCommand = −1.
Rationale: An accepted REVERSE request must produce the defined reverse command so the vehicle can move in the requested direction.

#### 3.3.2 [#39] Invalid Reverse Request Response
When REVERSE is requested and VehicleSpeed >= 0.5 m/s, the controller shall command GearCommand = 0
Rationale: Applying reverse driving torque while the vehicle is moving forward too quickly could produce an abrupt change in drivetrain loading.

### 3.4 [#24] Neutral Request Response
When NEUTRAL is requested, the controller shall command GearCommand = 0 regardless of VehicleSpeed.
Rationale: Keeping a driving/reverse gear commanded after a NEUTRAL request would leave propulsion available when the driver expects it to be disconnected.

## 4 [#11] Vehicle Performance
The vehicle shall accelerate from 0 to 60 mph in less than 12 seconds when wide-open-throttle is applied (100% throttle)
Rationale: If 0-60 acceleration time is greater than 12 seconds it will create unsafe situations on the road during merging and other high-acceleration manoeuvers.

## 5 [#19] Throttle Modification Duration
Any throttle modification used for RPM matching shall end within 1 second of its initiation
Rationale: Limiting duration allows brief RPM matching while avoiding an extended override of the driver request.

## 6 [#42] Brake Priority Over Throttle
When DriverBrake > 0, the controller shall command Throttle = 0 regardless of DriverThrottle.
Rationale: Prevents the engine from applying driving torque while the driver is braking.

## 7 [#31] Gear Command Control and Protection

### 7.1 [#32] Forward Gear Command Limit
When DRIVE is requested, VehicleSpeed > -0.5 m/s, and HoldNeutral = false, GearCommand shall be an integer from 1 through 10 inclusive.
Rationale: Avoids invalid gear requests.

### 7.2 [#33] DriveOnly Automatic Shifting

### 7.3 [#34] Shift Command Lockout
Following an automatic change between forward gear commands (Gears 1 through 10), the controller shall maintain the new GearCommand for at least 100 ms before commanding another automatic forward gear change. Driver range requests and direction reversal protection may override this hold.
Rationale: Small changes in RPM or throttle can cause repeated gear requests in quick succession. A minimum hold interval reduces gear hunting and avoids continuously changing the requested gear.

### 7.4 [#36] Direction Reversal Protection
When the requested range changes directly from DRIVE to REVERSE or from REVERSE to DRIVE, the controller shall command GearCommand = 0 while abs(VehicleSpeed) >= 0.1 m/s.
Rationale: Engaging the opposite direction before the vehicle has nearly stopped can abruptly oppose its motion and increase drivetrain loading. Holding neutral avoids applying the opposite driving direction too early.

### 7.5 [#37] Direction Reversal Neutral Dwell
Following a direct DRIVE-to-REVERSE or REVERSE-to-DRIVE request, the controller shall maintain GearCommand = 0 for at least 100 ms with abs(VehicleSpeed) < 0.1 m/s before commanding the requested direction.
Rationale: A brief neutral interval separates the previous driving direction from engagement of the new one.