test file "Transmission_Test_Suite"

suite "10-Speed Transmission Controller"

  case "ETRS 3" [baseline]
    model TransmissionSystem, mode Normal, start time 0, stop time 65
    assessment "ETRS 3.1": At any point of time, whenever DriveRangeSelector == Park & VehicleSpeed <= 0.1 is true then, with no delay, GearCommanded == 0 must be true
      GearCommanded: signal TransmissionControl/Transmission Controller, port 2
      DriveRangeSelector: signal TransmissionControl/Variant Source2, port 1
      VehicleSpeed: signal TransmissionControl/LongitudinalVehiclePlant, port 3
      Park: expression RangeSelected.Park

  case "ETRS 4" [simulation]
    model TransmissionSystem, mode Normal, start time 0, stop time 15, variant configuration Test
    input "ETRS_0-60Log.mat", mapped to DriverBrake, DriverThrottle, DriverGearSelection (active)
    assessment "ETRS 4": At any point of time, if VehSpd > 0.1 becomes true then, with a delay of at most 12, VehSpd > 60 must be true
      VehSpd: signal TransmissionControl/Signal Specification, port 1

suite "Gear Safety Tests"

  case "GS-01" [simulation]
    model TransmissionController, harness TransmissionController_Harness1 (for TransmissionController/GS-01), mode Normal, start time 0, stop time 12
    input "GS-01_testCase.mat", mapped to Driver Range Selection -> acceptedRange, candidateGear (active)
    assessment "Assessment1": At any point of time, ~(acceptedRange == 1 | acceptedRange == 2) | (gearCommand == 0) must be true
    assessment "Assessment2": At any point of time, ~(acceptedRange == 0) | (gearCommand == -1) must be true
    assessment "Assessment3": At any point of time, ~(acceptedRange == 3 & candidateGear >= 1 & candidateGear <= 10) | (gearCommand == candidateGear) must be true
    assessment "Assessment4": At any point of time, ~(acceptedRange == 3 & candidateGear > 10) | (gearCommand == 10) must be true
    assessment "Assessment5": At any point of time, ~(acceptedRange == 3 & candidateGear < 1) | (gearCommand == 1) must be true
      acceptedRange: signal TransmissionController_Harness1/Input Conversion Subsystem, port 1
      candidateGear: signal TransmissionController_Harness1/Input Conversion Subsystem, port 2
      gearCommand: signal TransmissionController_Harness1/GS-01, port 1

  case "GS-03" [simulation]
    model TransmissionController, harness TransmissionController_Harness2 (for TransmissionController/GS-03)
    input "GS-03_testCase.mat", mapped to engineSpeed, nominalShift (active)
    assessment "Assessment1": At any point of time, ~(engineSpeed <= 7250) | (safeShift == nominalShift) must be true
    assessment "Assessment2": At any point of time, ~(engineSpeed > 7250) | (safeShift == 1) must be true
      engineSpeed: signal TransmissionController_Harness2/Input Conversion Subsystem, port 1
      safeShift: signal TransmissionController_Harness2/GS-03, port 1
      nominalShift: signal TransmissionController_Harness2/Input Conversion Subsystem, port 2

  case "GS-04" [simulation]
    model TransmissionController, harness TransmissionController_Harness5 (for TransmissionController/GS-04), stop time 10
    input "GS-04_testCase.mat", mapped to candidateGear (active)
    assessment "Assessment1": At any point of time, ~(t < 2.0) | ((candidateGear == 1) & (targetGear == 1) & (shiftActive == false)) must be true
    assessment "Assessment2": At any point of time, ~((t >= 2.02) & (t < 2.50)) | ((candidateGear == 2) & (targetGear == 2) & (shiftActive == true)) must be true
    assessment "Assessment3": At any point of time, ~((t >= 2.50) & (t < 3.00)) | ((candidateGear == 3) & (targetGear == 2) & (shiftActive == true)) must be true
    assessment "Assessment4": At any point of time, ~((t >= 3.05) & (t < 3.95)) | ((candidateGear == 3) & (targetGear == 3) & (shiftActive == true)) must be true
      targetGear: signal TransmissionController_Harness5/GS-04, port 1
      shiftActive: signal TransmissionController_Harness5/GS-04, port 2
      candidateGear: signal TransmissionController_Harness5/Input Conversion Subsystem, port 1

suite "Performance and Efficiency Tests"

  suite "PE-01"

    case "PE-01-1" [simulation]
      description: At gear 3 and 5200 RPM, change only throttle from 0.2 to 0.8 and back; expect request true, false, true.
      model TransmissionController, harness TransmissionController_Harness4 (for TransmissionController/PE-01), mode Normal, start time 0, stop time 6
      input "PE-01 Input data file.mat", mapped to AcceptedRange, CurrentGear, EngineSpeed, DriverThrottle (active)
      logged signals "Signal Set 1": PE-01:1, AcceptedRange:1, CurrentGear:1, EngineSpeed:1, DriverThrottle:1
      assessment "Low demand requests upshift": At any point of time, whenever (double(acceptedRange) == 3) & (currentGear == 3) & (engineRPM == 5200) & (driverThrottle == 0.2) is true then, with a delay of at most 0.02, upShiftRequest == true must be true
      assessment "High demand retains gear": At any point of time, whenever (double(acceptedRange) == 3) & (currentGear == 3) & (engineRPM == 5200) & (driverThrottle == 0.8) is true then, with a delay of at most 0.02, upShiftRequest == false must be true
        acceptedRange: signal TransmissionController_Harness4/AcceptedRange, port 1
        currentGear: signal TransmissionController_Harness4/CurrentGear, port 1
        engineRPM: signal TransmissionController_Harness4/EngineSpeed, port 1
        driverThrottle: signal TransmissionController_Harness4/DriverThrottle, port 1
        upShiftRequest: signal TransmissionController_Harness4/Output Conversion Subsystem, port 1

  suite "PE-02"

    case "PE-02-1" [simulation]
      model TransmissionController, harness PE02_harness (for TransmissionController/PE-02 Reversal Hold), mode Normal, start time 0, stop time 0.06
      input "PE-02 input data file.mat", mapped to isDrive, delayGear, upRaw, downRaw
      input "PE02 Downshift Blocks Upshift data file.mat", mapped to isDrive, delayGear, upRaw, downRaw (active)
      logged signals "Signal Set 1": isDrive:1, delayGear:1, upRaw:1, downRaw:1, PE-02 Reversal Hold:3, PE-02 Reversal Hold:1, PE-02 Reversal Hold:2
      assessment "Initial state": At any point of time, whenever (t >= 0.00) & (t < 0.01) is true then, with no delay, (upHeld == 0) & (downHeld == 0) & (holdActive == false) must be true
      assessment "up proposal passes": At any point of time, whenever (t >= 0.01) & (t < 0.02) is true then, with no delay, (upHeld == 1) & (downHeld == 0) & (holdActive == false) must be true
      assessment "Confirmation blocks reversal": At any point of time, whenever (t >= 0.02) & (t < 0.03) is true then, with no delay, (upHeld == 0) & (downHeld == 0) & (holdActive == true) must be true
      assessment "Second blocked tick": At any point of time, whenever (t >= 0.03) & (t < 0.04) is true then, with no delay, (upHeld == 0) & (downHeld == 0) & (holdActive == true) must be true
      assessment "Release at expiry": At any point of time, whenever (t >= 0.04) & (t < 0.05) is true then, with no delay, (upHeld == 0) & (downHeld == -1) & (holdActive == false) must be true
      assessment "Repeated reversal passes": At any point of time, whenever (t >= 0.05) & (t < 0.06) is true then, with no delay, (upHeld == 0) & (downHeld == -1) & (holdActive == false) must be true
        upHeld: signal PE02_harness/Output Conversion Subsystem, port 3
        downHeld: signal PE02_harness/Output Conversion Subsystem, port 1
        holdActive: signal PE02_harness/Output Conversion Subsystem, port 2

    case "PE-02-2" [simulation]
      model TransmissionController, harness PE02_harness (for TransmissionController/PE-02 Reversal Hold)
      input "PE02 Downshift Blocks Upshift data file.mat", mapped to isDrive, delayGear, upRaw, downRaw (active)
      logged signals "Signal Set 1": isDrive:1, delayGear:1, upRaw:1, downRaw:1, PE-02 Reversal Hold:3, PE-02 Reversal Hold:1, PE-02 Reversal Hold:2
      assessment "Initial state": At any point of time, whenever (t >= 0.00) & (t < 0.01) is true then, with no delay, (upHeld == 0) & (downHeld == 0) & (holdActive == false) must be true
      assessment "Up proposal passes": At any point of time, whenever (t >= 0.01) & (t < 0.02) is true then, with no delay, (upHeld == 0) & (downHeld == -1) & (holdActive == false) must be true
      assessment "Opposite observed change": At any point of time, whenever (t >= 0.02) & (t < 0.03) is true then, with no delay, (upHeld == 0) & (downHeld == 0) & (holdActive == true) must be true
      assessment "Clear request": At any point of time, whenever (t >= 0.03) & (t < 0.04) is true then, with no delay, (upHeld == 0) & (downHeld == 0) & (holdActive == true) must be true
      assessment "Multi gear change": At any point of time, whenever (t >= 0.04) & (t < 0.05) is true then, with no delay, (upHeld == 1) & (downHeld == 0) & (holdActive == false) must be true
      assessment "No false ordinary hold": At any point of time, whenever (t >= 0.05) & (t < 0.06) is true then, with no delay, (upHeld == 1) & (downHeld == 0) & (holdActive == false) must be true
        upHeld: signal PE02_harness/Output Conversion Subsystem, port 3
        downHeld: signal PE02_harness/PE-02 Reversal Hold, port 1
        holdActive: signal PE02_harness/Output Conversion Subsystem, port 2

suite "Range Park Tests"

  suite "RP-01"

    case "BelowLimit" [baseline]
      model TransmissionController, harness RP01_TestHarness (for TransmissionController/RP-01 Drive Guard), mode Normal, start time 0, stop time 1
      input "RP_in_r01_test1.mat", mapped to Driver Range Selection -> Requested Range, VehicleSpeed (active)
      assessment "Assessment1": At any point of time, AcceptedRange == ExpectedRange must be true
        AcceptedRange: signal RP01_TestHarness/RP-01 Drive Guard, port 1
        ExpectedRange: expression RangeSelected.Neutral

    case "AtLimit" [baseline]
      model TransmissionController, harness RP01_TestHarness (for TransmissionController/RP-01 Drive Guard), mode Normal, start time 0, stop time 1
      input "RP_in_r01_test2.mat", mapped to Driver Range Selection -> Requested Range, VehicleSpeed (active)
      assessment "Assessment1": At any point of time, AcceptedRange == ExpectedRange must be true
        AcceptedRange: signal RP01_TestHarness/RP-01 Drive Guard, port 1
        ExpectedRange: expression RangeSelected.Neutral

    case "AboveLimit" [baseline]
      model TransmissionController, harness RP01_TestHarness (for TransmissionController/RP-01 Drive Guard), mode Normal, start time 0, stop time 1
      input "RP_in_r01_test3.mat", mapped to Driver Range Selection -> Requested Range, VehicleSpeed (active)
      assessment "Assessment1": At any point of time, AcceptedRange == ExpectedRange must be true
        AcceptedRange: signal RP01_TestHarness/RP-01 Drive Guard, port 1
        ExpectedRange: expression RangeSelected.Drive

  suite "RP-02"

    case "BelowLimit" [baseline]
      model TransmissionController, harness RP02_TestHarness (for TransmissionController/RP-02 Reverse Guard), mode Normal, start time 0, stop time 1
      input "RP_in_r02_test1.mat", mapped to Requested Range, VehicleSpeed (active)
      assessment "Assessment1": At any point of time, AcceptedRange == ExpectedRange must be true
        AcceptedRange: signal RP02_TestHarness/RP-02 Reverse Guard, port 1
        ExpectedRange: expression RangeSelected.Reverse

    case "AtLimit" [baseline]
      model TransmissionController, harness RP02_TestHarness (for TransmissionController/RP-02 Reverse Guard), mode Normal, start time 0, stop time 1
      input "RP_in_r02_test2.mat", mapped to Requested Range, VehicleSpeed (active)
      assessment "Assessment1": At any point of time, AcceptedRange == ExpectedRange must be true
        AcceptedRange: signal RP02_TestHarness/RP-02 Reverse Guard, port 1
        ExpectedRange: expression RangeSelected.Neutral

    case "AboveLimit" [baseline]
      model TransmissionController, harness RP02_TestHarness (for TransmissionController/RP-02 Reverse Guard), mode Normal, start time 0, stop time 1
      input "RP_in_r02_test3.mat", mapped to Requested Range, VehicleSpeed (active)
      assessment "Assessment1": At any point of time, AcceptedRange == ExpectedRange must be true
        AcceptedRange: signal RP02_TestHarness/RP-02 Reverse Guard, port 1
        ExpectedRange: expression RangeSelected.Neutral